# Grasshopper definition radialsig_script.gh (Grasshopper 1.0.7)
# plug-ins: DigitalCircularityToolkit, Human

brep = Brep([<brep referenced from the Rhino model> x55])
mesh = Mesh([<mesh referenced from the Rhino model> x65])
planeobj = PlanarObject(Geometry=mesh, NumSamples=50, Quantity=1, LengthBuffer=1, WidthBuffer=1, Thickness=-1)  # -> Object, EffectivePlane
objprops = ObjectProperties(Object=planeobj.Object)  # -> Centroid, PCA1, PCA2, PCA3, Length, Width, Height, BoundingBox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
deplane = DeconstructPlane(Plane=objprops.LocalPlane)  # -> Origin, XAxis, YAxis, ZAxis
multiplication = Multiplication(A=objprops.Length, B=Slider(0.74, range=0.5..1))
radial2d = RadialSig2D(DesignObject=planeobj.Object, NumSamples=Slider(23, range=5..50))  # -> Signature, SampledPoints, Hull, StartPoint
line = LineSDL(Start=deplane.Origin, Direction=deplane.XAxis, Length=multiplication)
crv = Curve(radial2d.Hull)
graph = QuickGraph(radial2d.Signature, SortOrder=0)
previewlw = CustomPreviewLineweights(Geometry=line, Shader=ColourSwatch(SwatchColor=RGB(255, 255, 255)), Thickness=Slider(3, range=1..5), Absolute=False)
pt = Point(radial2d.StartPoint)
pt_2 = Point(radial2d.SampledPoints)
item = ListItem(List=pt_2, Index=Slider(20, range=0..20), Wrap=True)
